% Simulink data dictionary LogisticsInterfaces.sldd

SupplyConvoy = Simulink.Bus()
  Trucks: double
  CargoTons: double

ThreatAction = Simulink.Bus()
  AmbushProb: double
  Posture: double

SupplyStatus = Simulink.Bus()
  StockTons: double
  DaysOfSupply: double

ConvoyStatus = Simulink.Bus()
  ConvoysEnRoute: double
  TonsLost: double

RouteOrder = Simulink.Bus()
  RouteId: double

InterdictionOrder = Simulink.Bus()
  Posture: double